# Grasshopper definition triceratops.gh (Grasshopper 1.0.7)
# plug-ins: Triceratops

colour = ColourPicker(PickedColour=RGB(95, 50, 219))
panel = Panel(colour)
export = Button()
update = Button()
pipeline = GeometryPipeline(
    GroupByLayer=False,
    GroupByType=False,
    IncludeHidden=True,
    IncludeLocked=True,
    LayerFilter="MODEL::BASE::3D::existingbuilding",
    NameFilter="*",
    SublayerFiltering=True,
    TypeFilter=1073741848)
pipeline_2 = GeometryPipeline(
    GroupByLayer=False,
    GroupByType=False,
    IncludeHidden=True,
    IncludeLocked=True,
    LayerFilter="ANNO::comments",
    NameFilter="*",
    SublayerFiltering=True,
    TypeFilter=1)
pipeline_3 = GeometryPipeline(
    GroupByLayer=False,
    GroupByType=False,
    IncludeHidden=True,
    IncludeLocked=True,
    LayerFilter="Default",
    NameFilter="*",
    SublayerFiltering=True,
    TypeFilter=4)
pipeline_4 = GeometryPipeline(
    GroupByLayer=False,
    GroupByType=False,
    IncludeHidden=True,
    IncludeLocked=True,
    LayerFilter="MODEL::BASE::3D::ground",
    NameFilter="*",
    SublayerFiltering=True,
    TypeFilter=32)
write = Button()
named_views_to_json = GhPythonScript(update=update)  # -> J
# ---------- named_views_to_json: Python ----------
import Rhino
import scriptcontext as sc
import json

sc.doc = Rhino.RhinoDoc.ActiveDoc

views = sc.doc.NamedViews.GetEnumerator()

result = []

for v in views:
    loc = v.Viewport.CameraLocation
    
    view = {
      'name': v.Name,
      'camera': {
        'location': [loc.X, loc.Y, loc.Z]
      }
    }
    result.append(view)
    print(v.Name)
    print(v.Viewport.CameraLocation)
    print(v.Viewport.Camera35mmLensLength)
    # IsParallelProjection
    # Camera35mmLensLength
    # see https://developer.rhino3d.com/api/RhinoCommon/html/T_Rhino_DocObjects_ViewportInfo.htm
    
J = json.dumps(result)

sc.doc = ghdoc
# ---------- end named_views_to_json ----------
dirlight = DirectionalLight(
    Position="100, 100, 100",
    Color=RGB(255, 255, 255),
    Intensity=0.5,
    CastShadow=Toggle(True),
    ShadowTop=10,
    ShadowBottom=-10,
    ShadowRight=10,
    ShadowLeft=-10,
    ShadowNear=0,
    ShadowFar=100)  # -> Helper, Light
geo = Geometry(dirlight.Helper)
writetxt = WriteTextFile(Path="/Users/carsten/Desktop", FileName="views.json", Data=named_views_to_json, Write=export)
basicmat = MeshBasicMaterial(Color="232,205,28")
objdet = ObjectDetails(Object=pipeline_2)  # -> Referenced, Available, Name, Layer, Colour, Guid
pointsmat = PointsMaterial(Color="95,50,219", Size="2", SizeAttenuation=Toggle(False), AlphaTest=0.5)
linebasicmat = LineBasicMaterial(Color="229,37,128", LineWidth=1)
basicmat_2 = MeshBasicMaterial(Color="232,205,28")
mesh = Mesh(Mesh=pipeline_4, Material=basicmat, DecimalAccuracy=3)
line = Line(Line=pipeline_3, LineMaterial=linebasicmat, DecimalAccuracy=3)
mesh_2 = Mesh(Mesh=pipeline, Material=basicmat_2, DecimalAccuracy=3)
points = Points(Points=pipeline_2, Name=objdet.Name, PointsMaterial=pointsmat, DecimalAccuracy=3)
scene = CompileScene(Objects=[line, mesh_2, dirlight.Light, mesh, points])
serialize = SerializeObject(Object3d=scene, Minify="true", Run=True)
writetxt_2 = WriteTextFile(Path="/Users/carsten/Desktop", FileName="sample.json", Data=serialize, Write=write)
output_path = Panel(writetxt_2)
